# Grasshopper definition sample_main.gh (Grasshopper 1.0.8)

# ---- group: python file usage sample
py3 = Python3Script()  # -> out, code_file_path
# ---------- py3: Python ----------
import os
import ghpythonlib

def main():
    doc = ghenv.Component.OnPingDocument()

    cur_path = os.path.dirname(doc.FilePath)
    code_file_path = os.path.join(cur_path, "..", "src", "file_sample.py")

    return code_file_path

if __name__ == "__main__":
    code_file_path = main()
# ---------- end py3 ----------
file = ReadFile(File=py3.code_file_path, PerLineParse=False)
py3_2 = Python3Script(script=file, x=Slider(3, range=0..10), y=Slider(5, range=0..10))  # -> out, a; unedited script template

# ---- group: Cluster Referencing Sample 1
cluster = Cluster(x=py3_2.a, y=Slider(3, range=0..10), z=Slider(4, range=0..10))
panel = Panel(cluster)

# ==== cluster Cluster
x = ClusterInput()
y = ClusterInput()
z = ClusterInput()
sum = Python3Script(x=x, y=y)  # -> out, v
# ---------- sum: Python ----------
v = x + y
# ---------- end sum ----------
power = Python3Script(v=sum.v, z=z)  # -> out, a
# ---------- power: Python ----------
a = v ** z
# ---------- end power ----------
a = ClusterOutput(power.a)
